# Grasshopper definition 06_analiza_denisitate_POT_2025.gh (Grasshopper 1.0.7)
# plug-ins: EleFront, Pufferfish

pipeline = GeometryPipeline(
    GroupByLayer=False,
    GroupByType=False,
    IncludeHidden=True,
    IncludeLocked=True,
    LayerFilter="analiza::contur limita analiza",
    NameFilter="*",
    SublayerFiltering=True,
    TypeFilter=4)
pipeline_2 = GeometryPipeline(
    GroupByLayer=False,
    GroupByType=False,
    IncludeHidden=True,
    IncludeLocked=True,
    LayerFilter="urbanism::Parcele blocuri",
    NameFilter="*",
    SublayerFiltering=True,
    TypeFilter=4)
# Analiză densitate - POT
# 
# Analiza denistate urbană -
#  procent ocupare teren.
# 
# Script dezvoltat în cadrul proiectului
# SCHOLAR ARCHITECT 2024
# Proiect finațat prin CNFIS-FDI-2024-F-0032.
# Autori: Ionuț Anton și Ana Daniela Anton
pipeline_3 = GeometryPipeline(
    GroupByLayer=False,
    GroupByType=False,
    IncludeHidden=True,
    IncludeLocked=True,
    LayerFilter="propunere::Constructii",
    NameFilter="*",
    SublayerFiltering=True,
    TypeFilter=4)
pipeline_4 = GeometryPipeline(
    GroupByLayer=False,
    GroupByType=False,
    IncludeHidden=True,
    IncludeLocked=True,
    LayerFilter="urbanism::Constructii",
    NameFilter="*",
    SublayerFiltering=True,
    TypeFilter=4)
pipeline_5 = GeometryPipeline(
    GroupByLayer=False,
    GroupByType=False,
    IncludeHidden=True,
    IncludeLocked=True,
    LayerFilter="urbanism::Parcele",
    NameFilter="*",
    SublayerFiltering=True,
    TypeFilter=4)

# ---- group: Click aici pentru bake in rhino
button = Button()

# ----
constructii = Curve(pipeline_4)
propunere = Curve(pipeline_3)
parcele = Curve(pipeline_5)
parcele_blocuri = Curve(pipeline_2)
crv = Curve(pipeline)
merge = Merge(Data1=flatten(propunere), Data2=flatten(constructii))
merge_2 = Merge(Data1=flatten(parcele), Data2=flatten(parcele_blocuri))  # -> graft(Result)
area = Area(Geometry=merge)  # -> Area, Centroid
incurve = PointInCurve(Point=area.Centroid, Curve=graft(merge_2))  # -> Relationship, Point
area_2 = Area(Geometry=graft(merge_2))  # -> Area, Centroid
equals = Equality(FirstNumber=incurve.Relationship, SecondNumber="2")  # -> Equality, Inequality
cull = CullPattern(List=area.Area, CullPattern=equals.Equality)
ma = MassAddition(Input=cull)  # -> Result, PartialResults
division = Division(A=ma.Result, B=area_2.Area)
roundd = RoundToDecimalPlace(NumberX=division, DecimalPlace=Slider(2, range=0..10), RoundType=0)  # -> Rounded, Difference
bnd = Bounds(Numbers=flatten(roundd.Rounded))
dedomain = DeconstructDomain(Domain=bnd)  # -> Start, End
gradient = Gradient(
    LowerLimit=dedomain.Start,
    UpperLimit=dedomain.End,
    Parameter=roundd.Rounded,
    stops=[0: RGB(222, 196, 245), 1: RGB(119, 0, 255)])
hatch = DefineHatch(Curve=merge_2, Pattern="Solid", Rotation=0, Scale=1)  # -> graft(Hatch)

trigger = Trigger(Interval=60000, TimerInterval=60000, Target=time)
time = Time("now")
format = Format(Format="{0:yyyy-MM-dd-HH-mm-ss}", Culture=127, Data0=time)
concat = Concatenate(FragmentA="analiza_out::denistate_POT::", FragmentB=format)
concat_2 = Concatenate(FragmentA=concat, FragmentB="::analiza")
layer = DefineLayer(Name=concat_2)

bbox = BoundingBox(Content=crv, Plane=PlaneXY(0, 0, 0))  # -> Box, Box_2
evalsrf = EvaluateSurface(Surface=reparameterize(bbox.Box), Point="{1,0,0}")  # -> Point, Normal, UDirection, VDirection, Frame
Y = UnitY(Factor="-100")
move = Move(Geometry=evalsrf.Point, Motion=Y)  # -> Geometry, Transform
list = ValueList({"Default", "Legenda"}, selected="Legenda")
range = Range(Domain=bnd, Steps=expr("x-1", "5"))
range_2 = Range(Domain=Domain(0, 1), Steps=expr("x-1", "5"))
sqgrid = Square(Plane=move.Geometry, Size=Slider(50, range=0..100), ExtentX="5", ExtentY="1")  # -> Cells, Points
text = DefineTextObject(Text="densitate_POT", Plane=evalsrf.Point, DimensionStyle=list, OutputType="Text")
hatch_2 = DefineHatch(Curve=flatten(sqgrid.Cells), Pattern="Solid", Rotation=0, Scale=1)
gradient_2 = Gradient(LowerLimit=0, UpperLimit=1, Parameter=range_2, stops=[0: RGB(222, 196, 245), 1: RGB(119, 0, 255)])
area_3 = Area(Geometry=flatten(sqgrid.Cells))  # -> Area, Centroid
roundd_2 = RoundToDecimalPlace(NumberX=range, DecimalPlace=2, RoundType=0)  # -> Rounded, Difference
swatch = ColourSwatch(SwatchColor=RGB(0, 0, 0))
Y_2 = UnitY(Factor="-30")
concat_3 = Concatenate(FragmentA=concat, FragmentB="::legenda")
move_2 = Move(Geometry=area_3.Centroid, Motion=Y_2)  # -> Geometry, Transform
layer_2 = DefineLayer(Name=concat_3)
text_2 = DefineTextObject(Text=roundd_2.Rounded, Plane=move_2.Geometry, DimensionStyle="Legenda_numere", OutputType="Text")
lng = ListLength(List=text_2)
dup = DuplicateData(Data=swatch, Number=lng, Order=True)
attributes = DefineObjectAttributes(Layer=layer_2, Color=gradient_2)
attributes_2 = DefineObjectAttributes(Layer=layer_2, Color=dup)
attributes_3 = DefineObjectAttributes(Layer=layer_2, Color=swatch)
merge_3 = Merge(Data1=flatten(hatch), Data2=flatten(text), Data3=flatten(text_2), Data4=flatten(hatch_2))

lng_2 = ListLength(List=roundd.Rounded)
dup_2 = DuplicateData(Data="densitate_POT", Number=lng_2, Order=True)
attributes_4 = DefineObjectAttributes(UserKeys=dup_2, UserValues=roundd.Rounded, Layer=layer, Color=gradient)

merge_4 = Merge(Data1=flatten(attributes_4), Data2=flatten(attributes_3), Data3=flatten(attributes_2), Data4=flatten(attributes))

deatt = DeconstructAttributes(ReferencedGeometryOrAttributes=merge_4)  # -> Keys, Values, Name, Layer, Color
bake = BakeObjects(Geometry=merge_3, Attributes=merge_4, Bake=button)
material = CreateMaterial(Diffuse=deatt.Color, Specular=RGB(255, 255, 255), Emission=RGB(0, 0, 0), Transparency=0, Shine=0)
preview = CustomPreview(Geometry=merge_3, Shader=flatten(material))
